# Grasshopper definition clips.gh (Grasshopper 1.0.7)

geometry = Geometry([<curve referenced from the Rhino model> x2, <brep referenced from the Rhino model> x2])
rectangular_array = RectangularArray(
    Geometry=geometry,
    Cell={Plane=PlaneXY(0, 0, 0), Size=Domain2(u=0..10, v=0..5)},
    XCount=Slider(3, range=1..4),
    YCount=Slider(3, range=1..4))  # -> Geometry, Transform
