# Grasshopper definition nestedcircles_v3.gh (Grasshopper 1.0.7)

number_slider = Slider(4, range=1..4)
circleprofile = Curve(<curve referenced from the Rhino model>)
nullvec = Vector(Vector(0, 0, 0))
linear_array = LinearArray(Geometry=circleprofile, Direction=nullvec, Count=number_slider)  # -> Geometry, Transform
series = Series(Start=1, Step=0.2, Count=number_slider)
scale = Scale(Geometry=linear_array.Geometry, Center=Point(0, 0, 0), Factor=series)  # -> Geometry, Transform
wall = Slider(7.812, range=1..20)
unit_z = UnitZ(Factor=wall)
offset_curve = OffsetCurve(Curve=scale.Geometry, Distance=Slider(1.772, range=0..10), Plane=PlaneXY(0, 0, 0), Corners=1)
merge = Merge(Data1=graft(scale.Geometry), Data2=offset_curve)
boundary_surfaces = BoundarySurfaces(Edges=merge)
extrude = Extrude(Base=boundary_surfaces, Direction=unit_z)
